# Grasshopper definition Auto-Adjust-Textures.gh (Grasshopper 1.0.8)
# Copyright: AMDlab
# plug-ins: RhinoCodePluginGH

移動する最大範囲 = DigitScroller(Scroller_Digits=12, Scroller_Prefix="移動する最大範囲", Scroller_Radix=11, Scroller_Value=100)
方向調整する最大範囲 = DigitScroller(Scroller_Digits=12, Scroller_Prefix="方向調整する最大範囲", Scroller_Radix=11, Scroller_Value=1)
ランダムシード = DigitScroller(Scroller_Digits=12, Scroller_Prefix="ランダムシード", Scroller_Radix=11, Scroller_Value=3)
テクスチャの位置を修正したいモデル = GeometryPipeline(
    GroupByLayer=False,
    GroupByType=False,
    IncludeHidden=True,
    IncludeLocked=True,
    LayerFilter="デフォルト",
    NameFilter="*",
    SublayerFiltering=True,
    TypeFilter=1073741848)
lng = ListLength(List=テクスチャの位置を修正したいモデル)

# ----
# テクスチャをランダムへ調整
symdom = SymmetricDomain(A=移動する最大範囲)  # -> I; inputs A: Double
#   port A: Value of numeric domain
#   port I: Numeric domain between {-A} and {A}
# ---------- symdom: C# ----------
// Grasshopper Script Instance
#region Usings
using System;
using System.Linq;
using System.Collections;
using System.Collections.Generic;
using System.Drawing;

using Rhino;
using Rhino.Geometry;

using Grasshopper;
using Grasshopper.Kernel;
using Grasshopper.Kernel.Data;
using Grasshopper.Kernel.Types;
#endregion

public class Script_Instance : GH_ScriptInstance
{
    #region Notes
    /* 
      Members:
        RhinoDoc RhinoDocument
        GH_Document GrasshopperDocument
        IGH_Component Component
        int Iteration

      Methods (Virtual & overridable):
        Print(string text)
        Print(string format, params object[] args)
        Reflect(object obj)
        Reflect(object obj, string method_name)
    */
    #endregion

    private void RunScript(double A, ref object I)
    {
        /*
        Copyright 2024 Saito40

        Licensed under the Apache License, Version 2.0 (the "License");
        you may not use this file except in compliance with the License.
        You may obtain a copy of the License at

            http://www.apache.org/licenses/LICENSE-2.0

        Unless required by applicable law or agreed to in writing, software
        distributed under the License is distributed on an "AS IS" BASIS,
        WITHOUT WARRANTIES OR CONDITIONS OF ANY KIND, either express or implied.
        See the License for the specific language governing permissions and
        limitations under the License.

        __author__ = {
            "Name": "Saito40",
            "Website": "https://github.com/Saito40/MiniHopper"
        }
    */

        I = new Interval(-A, A);
    }
}
# ---------- end symdom ----------
symdom_2 = SymmetricDomain(A=方向調整する最大範囲)  # -> I; inputs A: Double; same code as symdom
rectangle = Rectangle(Plane=PlaneXY(0, 0, 0), XSize=symdom, YSize=symdom, Radius=0)  # -> Rectangle, Length
rectangle_2 = Rectangle(Plane=PlaneXY(0, 0, 0), XSize=symdom_2, YSize=symdom_2, Radius=0)  # -> Rectangle, Length
addition = Addition(A=ランダムシード, B="1")
pop2d = Populate2D(Region=rectangle.Rectangle, Count=lng, Seed=ランダムシード)
pop2d_2 = Populate2D(Region=rectangle_2.Rectangle, Count=lng, Seed=addition)
Z = UnitZ(Factor=移動する最大範囲)
xy = XYPlane(Origin=pop2d)
addition_2 = Addition(A=pop2d_2, B=Z)
padjust = AdjustPlane(Plane=xy, Normal=addition_2)

id = Guid(テクスチャの位置を修正したいモデル)
brep = Brep(テクスチャの位置を修正したいモデル)

# ----
# 最小表面積の平面取得
debrep = DeconstructBrep(Brep=brep)  # -> Faces, Edges, Vertices
area = Area(Geometry=debrep.Faces)  # -> Area, Centroid
sort = SortList(Keys=area.Area, ValuesA=area.Centroid, ValuesB=debrep.Faces)  # -> Keys, ValuesA, ValuesB
item = ListItem(List=sort.ValuesA, Index=0, Wrap=True)  # -> flatten(Item)
item_2 = ListItem(List=sort.ValuesB, Index=0, Wrap=True)  # -> flatten(Item)
srf_cp = SurfaceClosestPoint(Point=item, Surface=item_2)  # -> Point, UVPoint, Distance
evalsrf = EvaluateSurface(Surface=item_2, Point=srf_cp.UVPoint)  # -> Point, Normal, UDirection, VDirection, Frame

# ----
# テクスチャ位置最終調整
xy_2 = XYPlane(Origin=Point(0, 0, 0))
orient = Orient(Geometry=padjust, Source=xy_2, Target=evalsrf.Frame)  # -> Geometry, Transform

実行 = BooleanToggle(False)
自動テクスチャ調整 = Python3Script(Run=実行, guid=id, plane=orient.Geometry)  # -> out; inputs Run: Boolean, guid: Guid
# ---------- 自動テクスチャ調整: Python ----------
import Rhino
from Rhino.Render import TextureMapping
from Rhino.Geometry import Interval
import scriptcontext as sc
import rhinoscriptsyntax as rs

if Run:
    sc.doc = Rhino.RhinoDoc.ActiveDoc

    a = []
    rhino_obj = rs.coercerhinoobject(guid)

    dom = Interval(-250, 250)
    tm = TextureMapping.CreatePlaneMapping(plane, dom, dom, dom, True)
    rhino_obj.SetTextureMapping(1, tm)

    sc.doc = ghdoc
# ---------- end 自動テクスチャ調整 ----------
